# Grasshopper definition urdf_loader.gh (Grasshopper 1.0.8)
# plug-ins: RhinoCodePluginGH

panel = Panel("/Users/avery_tsai/project/hiwin_prc/config/output.json")
number_slider = Slider(1, range=0..1)
number_slider_2 = Slider(10, range=0..10)
py3 = Python3Script(Reload=Button())  # -> out, Points; inputs Reload: Boolean
# ---------- py3: Python ----------
# Grasshopper GhPython: Trajectory JSON Loader
# Inputs:
#   - JsonPath (text, optional): 指定 JSON 檔案路徑；若未提供，會嘗試預設路徑
#   - Reload (bool, optional): True 時強制重新讀取檔案
# Outputs:
#   - Points (list[list[float]]): 每筆 6 軸關節值的清單（長度不足自動補 0）

import os
import json

try:
    import scriptcontext as sc
except Exception:
    sc = None

DEFAULT_JSON_ABS = r"/Users/avery_tsai/project/hiwin_prc/config/output.json"
DEFAULT_JSON_REL = os.path.join('config', 'output.json')
NUM_JOINTS = 6


def _get_cache():
    # sticky 快取：{ path: (mtime, points) }
    if sc is None:
        if not hasattr(_get_cache, "_mem"):
            _get_cache._mem = {}
        return _get_cache._mem
    d = sc.sticky.get('TRAJ_CACHE')
    if not isinstance(d, dict):
        d = {}
        sc.sticky['TRAJ_CACHE'] = d
    return d


def _resolve_json_path(preferred=None):
    cands = []
    if preferred:
        cands += [preferred, os.path.abspath(os.path.expanduser(preferred))]
    cands += [DEFAULT_JSON_ABS, os.path.abspath(DEFAULT_JSON_REL)]
    for p in cands:
        try:
            if p and os.path.exists(p):
                return p
        except Exception:
            pass
    return None


def _coerce_six(values):
    out = []
    if values is None:
        values = []
    for v in values:
        try:
            out.append(float(v))
        except Exception:
            out.append(0.0)
        if len(out) >= NUM_JOINTS:
            break
    while len(out) < NUM_JOINTS:
        out.append(0.0)
    return out


def _load_points(json_path, reload=False):
    cache = _get_cache()
    try:
        mtime = os.path.getmtime(json_path) if json_path else None
    except Exception:
        mtime = None

    if (not reload) and json_path and (mtime is not None):
        cached = cache.get(json_path)
        if cached and isinstance(cached, tuple) and len(cached) == 2 and cached[0] == mtime:
            return cached[1]

    if not json_path:
        pts_list = []
    else:
        try:
            with open(json_path, 'r') as f:
                data = json.load(f)
        except Exception:
            pts_list = []
        else:
            pts = data.get('points') if isinstance(data, dict) else None
            if not isinstance(pts, list):
                pts_list = []
            else:
                pts_list = []
                for p in pts:
                    pos = None
                    if isinstance(p, dict):
                        pos = p.get('positions')
                    elif isinstance(p, (list, tuple)):
                        pos = p
                    pts_list.append(_coerce_six(pos))

    if json_path and (mtime is not None):
        cache[json_path] = (mtime, pts_list)
    return pts_list


# ---- Main ----
preferred = JsonPath if 'JsonPath' in globals() and JsonPath else None
reload_flag = bool(globals().get('Reload', False))

json_path = _resolve_json_path(preferred)
Points = _load_points(json_path, reload=reload_flag)
# ---------- end py3 ----------
py3_2 = Python3Script(slider=Slider(0.79, range=0..1), Reload=Button())  # -> out, joints, all_points; inputs slider: Double, Reload: Boolean
# ---------- py3_2: Python ----------
# Grasshopper GhPython: Robot Trajectory Player
# 功能: 讀取 JSON (config/output.json) 的 points[*].positions，輸出當前 joints 與完整 all_points
# 輸入參數 (GhPython Inputs):
#   - slider (float, 0.0~1.0): 軌跡位置選擇器，0=第一點，1=最後一點，中間值選擇最接近的點
# 輸出參數 (GhPython Outputs):
#   - joints (list[float]): 當前 6 軸關節值 [J1..J6]
#   - all_points (list[list[float]]): 完整軌跡 (每個子清單 6 個數字)

import os
import json

try:
    import scriptcontext as sc
except Exception:
    sc = None

# 預設 JSON 路徑（優先使用絕對路徑，失敗則嘗試相對路徑）
DEFAULT_JSON_ABS = r"/Users/avery_tsai/project/hiwin_prc/config/output.json"
DEFAULT_JSON_REL = os.path.join('config', 'output.json')

# 內部常數
NUM_JOINTS = 6
DEFAULT_JOINTS = [0.0] * NUM_JOINTS


def _get_cache():
    """簡單快取（Grasshopper sticky），結構：{ path: (mtime, points) }"""
    if sc is None:
        # 非 GH 環境時，回傳揮發性容器
        if not hasattr(_get_cache, "_mem"):
            _get_cache._mem = {}
        return _get_cache._mem
    d = sc.sticky.get('TRAJ_CACHE')
    if not isinstance(d, dict):
        d = {}
        sc.sticky['TRAJ_CACHE'] = d
    return d


def _resolve_json_path(preferred=None):
    """依序嘗試多個候選路徑，回傳第一個存在的路徑或 None。"""
    candidates = []
    if preferred:
        candidates += [preferred, os.path.abspath(os.path.expanduser(preferred))]
    candidates += [DEFAULT_JSON_ABS, os.path.abspath(DEFAULT_JSON_REL)]
    for p in candidates:
        try:
            if p and os.path.exists(p):
                return p
        except Exception:
            pass
    return None


def _coerce_six(values):
    """將任意可迭代的數值列表裁切/補齊為 6 個 float。"""
    out = []
    if values is None:
        values = []
    for v in values:
        try:
            out.append(round(float(v), 5))
        except Exception:
            out.append(0.0)
        if len(out) >= NUM_JOINTS:
            break
    while len(out) < NUM_JOINTS:
        out.append(0.0)
    return out


def _load_points(json_path, reload=False):
    """讀取 JSON 並回傳 list[list[float]]，每個子清單為 6 軸關節。支援快取與 reload。"""
    cache = _get_cache()
    try:
        mtime = os.path.getmtime(json_path) if json_path else None
    except Exception:
        mtime = None

    # cache hit
    if (not reload) and json_path and (mtime is not None):
        cached = cache.get(json_path)
        if cached and isinstance(cached, tuple) and len(cached) == 2 and cached[0] == mtime:
            return cached[1]

    # load from disk
    if not json_path:
        pts_list = []
    else:
        try:
            with open(json_path, 'r') as f:
                data = json.load(f)
        except Exception:
            pts_list = []
        else:
            pts = data.get('points') if isinstance(data, dict) else None
            if not isinstance(pts, list):
                pts_list = []
            else:
                pts_list = []
                for p in pts:
                    pos = None
                    if isinstance(p, dict):
                        pos = p.get('positions')
                    elif isinstance(p, (list, tuple)):
                        pos = p
                    pts_list.append(_coerce_six(pos))

    # update cache
    if json_path and (mtime is not None):
        cache[json_path] = (mtime, pts_list)
    return pts_list


def _pick_index(t, n):
    """根據 slider t (0..1) 與總長度 n，回傳最接近的索引。n<=0 時回傳 None。"""
    if n <= 0:
        return None
    if t is None:
        t = 0.0
    try:
        t = float(t)
    except Exception:
        t = 0.0
    if t < 0.0:
        t = 0.0
    if t > 1.0:
        t = 1.0
    # 對映到 [0, n-1]，取最接近整數
    if n == 1:
        return 0
    return int(round(t * (n - 1)))


# 解析 JSON 路徑（支援自訂輸入 JsonPath/json_path）
preferred = None
for key in ('JsonPath', 'json_path', 'JSONPath', 'path'):
    if key in globals() and globals().get(key):
        preferred = globals().get(key)
        break
json_path = _resolve_json_path(preferred)

# 解析 Reload 按鈕（布林）；預設 False
reload_flag = False
for key in ('Reload', 'reload', 'RELOAD'):
    if key in globals():
        try:
            reload_flag = bool(globals().get(key))
        except Exception:
            reload_flag = False
        break

# 載入所有軌跡點（含快取與 reload）
all_points = _load_points(json_path, reload=reload_flag)

# 依 slider/t 選擇 joints
slider_val = None
for key in ('slider', 't', 'T'):
    if key in globals():
        slider_val = globals().get(key)
        break
idx = _pick_index(slider_val, len(all_points))
if idx is None:
    joints = list(DEFAULT_JOINTS)
else:
    try:
        joints = list(all_points[idx])
    except Exception:
        joints = list(DEFAULT_JOINTS)

# 輸出：joints, all_points
# ---------- end py3_2 ----------
panel_2 = Panel(py3.out)
item = ListItem(List=py3_2.joints, Index=0, Wrap=True)
trigger = Trigger(Interval=500, TimerInterval=500, Target=py3_3)
py3_3 = Python3Script(IP="192.168.0.216", Start=Toggle(True))  # -> out, joints_state; inputs IP: String, Start: Boolean
# ---------- py3_3: Python ----------
# Grasshopper: ROS joint state subscriber via rosbridge
# Inputs:
#   start (bool)      - start/stop the subscriber (True to connect, False to disconnect)
#   ip (str)          - rosbridge host, default "localhost"
# Outputs:
#   joints_state (list) - latest positions array from sensor_msgs/JointState
# requirements: roslibpy
# requirements: roslibpy

import sys
import json

try:
    import scriptcontext as sc
except ImportError:
    sc = None  # Running outside Rhino/Grasshopper

# Try to import roslibpy (Python client for rosbridge)
try:
    import roslibpy
except ImportError:
    roslibpy = None

STATE_KEY = 'ROS_JOINT_SUBSCRIBER_STATE'
DEFAULT_PORT = 9090
TOPIC_NAME = '/joint_states_target'
TOPIC_TYPE = 'sensor_msgs/JointState'


def _get_state():
    state = None
    if sc is not None:
        state = sc.sticky.get(STATE_KEY)
        if state is None:
            state = {'ros': None, 'topic': None, 'positions': [], 'connected': False}
            sc.sticky[STATE_KEY] = state
    else:
        # Fallback for non-GH environments
        if not hasattr(_get_state, '_state'):
            _get_state._state = {'ros': None, 'topic': None, 'positions': [], 'connected': False}
        state = _get_state._state
    return state


def _clear_state():
    if sc is not None and STATE_KEY in sc.sticky:
        del sc.sticky[STATE_KEY]
    else:
        if hasattr(_get_state, '_state'):
            _get_state._state = {'ros': None, 'topic': None, 'positions': [], 'connected': False}


def _on_message(state, msg):
    try:
        # sensor_msgs/JointState has fields: name[], position[], velocity[], effort[]
        positions = msg.get('position') or []
        # Make sure it's a plain Python list of floats
        state['positions'] = [float(x) for x in positions]
    except Exception:
        # On malformed data, do not break subscriber; keep last positions
        pass


def _ensure_connected(state, host, port):
    if state['ros'] is not None and getattr(state['ros'], 'is_connected', False):
        return True
    if roslibpy is None:
        return False
    try:
        ros = roslibpy.Ros(host=host, port=port)
        ros.run()  # starts background thread, non-blocking
        state['ros'] = ros
        state['connected'] = True
        return True
    except Exception:
        state['ros'] = None
        state['connected'] = False
        return False


def _ensure_subscribed(state):
    if roslibpy is None:
        return False
    if state['ros'] is None or not state['ros'].is_connected:
        return False
    if state['topic'] is None:
        try:
            topic = roslibpy.Topic(state['ros'], TOPIC_NAME, TOPIC_TYPE)
            # Bind callback with state
            topic.subscribe(lambda msg: _on_message(state, msg))
            state['topic'] = topic
        except Exception:
            state['topic'] = None
            return False
    return True


def _disconnect(state):
    # Unsubscribe and close connection
    try:
        if state.get('topic') is not None:
            try:
                state['topic'].unsubscribe()
            except Exception:
                pass
            state['topic'] = None
        if state.get('ros') is not None:
            try:
                state['ros'].close()
            except Exception:
                pass
            state['ros'] = None
    finally:
        state['connected'] = False


# -------- Grasshopper IO handling --------

# Defaults for GH inputs
try:
    start  # type: ignore[name-defined]
except NameError:
    start = False  # type: ignore[assignment]

try:
    ip  # type: ignore[name-defined]
except NameError:
    ip = 'localhost'  # type: ignore[assignment]

state = _get_state()

if not start:
    # Stop and clean
    _disconnect(state)
    joints_state = list(state.get('positions') or [])  # type: ignore[name-defined]
else:
    # Start / keep running
    host = ip or 'localhost'
    if _ensure_connected(state, host, DEFAULT_PORT):
        _ensure_subscribed(state)
    else:
        # Not connected (roslibpy missing or connection failed)
        pass
    joints_state = list(state.get('positions') or [])  # type: ignore[name-defined]

# Helpful message when roslibpy is missing (visible in GH out panel if user prints it)
if roslibpy is None:
    # You can install with: pip install roslibpy
    # In Rhino 8 CPython: Tools > Python > Manage Packages ...
    # Or run in your environment/venv.
    try:
        _ = joints_state  # type: ignore[name-defined]
    except Exception:
        pass
# ---------- end py3_3 ----------
panel_3 = Panel("/Users/avery_tsai/OrbStack/docker/volumes/walker_arm/src/walker_arm/hiwin_description")
panel_4 = Panel(py3_3.out)
merge = Merge(
    Data1=Slider(50, range=-170..170),
    Data2=Slider(-47, range=-150..95),
    Data3=Slider(27, range=-85..185),
    Data4=Slider(-47, range=-190..190),
    Data5=Slider(-16, range=-135..135),
    Data6=Slider(43, range=-360..360))
panel_5 = Panel("/Users/avery_tsai/OrbStack/docker/volumes/walker_arm/src/walker_arm/hiwin_description/urdf/rebar_arm.urdf")
merge_2 = Merge(
    Data1=Slider(-88, range=-185..85),
    Data2=Slider(-79, range=-155..35),
    Data3=Slider(117, range=-130..154),
    Data4=Slider(87, range=-350..350),
    Data5=Slider(3, range=-130..130),
    Data6=Slider(61, range=-350..350))
py3_4 = Python3Script(DirPath=panel_3, Reload=Button())  # -> out, Meshes, Paths; inputs DirPath: String, Reload: Boolean
# ---------- py3_4: Python ----------
# ========== 電池01：載入網格 ==========
# 輸入：DirPath (str), Reload (bool)
# 輸出：Meshes, Paths

import sys
sys.path.append(r"/Users/avery_tsai/project/hiwin_prc")
from robot import mesh_loader

# 載入網格（自動遞迴搜尋 .stl 檔案）
Meshes, Paths = mesh_loader.load(
    DirPath if 'DirPath' in globals() and DirPath else r"/Users/avery_tsai/project/hiwin_prc/urdf/walker_arm",
    Reload if 'Reload' in globals() else False
)

a = Meshes
# ---------- end py3_4 ----------
panel_6 = Panel("/Users/avery_tsai/project/robosim/urdf/kuka_kr300_support/urdf/kr300r2500ultra.urdf")
toggle = BooleanToggle(True)
button = Button()
py3_5 = Python3Script(DirPath="/Users/avery_tsai/project/robosim/urdf/kuka_kr300_support", Reload=Button())  # -> out, Meshes, Paths; inputs DirPath: String, Reload: Boolean; same code as py3_4
py3_6 = Python3Script(URDFPath=panel_5, Meshes=py3_4.Meshes, MeshPaths=py3_4.Paths, J=merge, Deg=toggle, Reload=button)  # -> out, G, a, Names, JointOrder; inputs URDFPath: String, Meshes: list of Mesh, MeshPaths: list of String, J: list of Double, Deg: Boolean, Reload: Boolean
# ---------- py3_6: Python ----------
# ========== 電池02：URDF 運動學 ==========
# 輸入：URDFPath (str), Meshes (list), MeshPaths (list), J (list), Deg (bool), Reload (bool)
# 輸出：G, Names, JointOrder

import sys
sys.path.append(r"/Users/avery_tsai/project/hiwin_prc")
from robot import urdf_loader

# 載入 URDF 並計算運動學
G, Names, JointOrder = urdf_loader.load(
    URDFPath if 'URDFPath' in globals() and URDFPath else r"/Users/avery_tsai/project/hiwin_prc/urdf/walker_arm/urdf/walker_arm.urdf",
    Meshes if 'Meshes' in globals() else [],
    MeshPaths if 'MeshPaths' in globals() else [],
    J if 'J' in globals() and J else [0, 0, 0, 0, 0, 0],
    Deg if 'Deg' in globals() else True,
    Reload if 'Reload' in globals() else False
)

a = G
# ---------- end py3_6 ----------
py3_7 = Python3Script(URDFPath=panel_6, Meshes=py3_5.Meshes, MeshPaths=py3_5.Paths, J=merge_2, Deg=Toggle(True), Reload=Button())  # -> out, G, a, Names, JointOrder; inputs URDFPath: String, Meshes: list of Mesh, MeshPaths: list of String, J: list of Double, Deg: Boolean, Reload: Boolean; same code as py3_6
ipy2 = IronPython2Script(URDFPath=panel_5, Meshes=py3_4.Meshes, MeshPaths=py3_4.Paths, J=merge, Deg=toggle, Reload=button)  # -> out, G, a; inputs URDFPath: String, Meshes: list of Mesh, MeshPaths: list of String, J: list, Deg: Boolean, Reload: Boolean
# ---------- ipy2: IronPython ----------
import sys
sys.path.append(r"/Users/avery_tsai/project/hiwin_prc")
from robot import urdf_loader

# 載入 URDF 並計算運動學
G, Names, JointOrder = urdf_loader.load(
    URDFPath if 'URDFPath' in globals() and URDFPath else r"/Users/avery_tsai/project/hiwin_prc/urdf/walker_arm/urdf/walker_arm.urdf",
    Meshes if 'Meshes' in globals() else [],
    MeshPaths if 'MeshPaths' in globals() else [],
    J if 'J' in globals() and J else [0, 0, 0, 0, 0, 0],
    Deg if 'Deg' in globals() else True,
    Reload if 'Reload' in globals() else False
)

a = G
# ---------- end ipy2 ----------
scale = Scale(Center=Point(0, 0, 0), Factor=Slider(1000, range=0..1000))  # -> Geometry, Transform
scale_2 = Scale(Geometry=py3_6.G, Center=Point(0, 0, 0), Factor=Slider(1000, range=0..1000))  # -> Geometry, Transform
panel_7 = Panel(py3_7.G)
panel_8 = Panel(py3_6.JointOrder)
